# Grasshopper definition View to the Outdoors Through a Facade.gh (Grasshopper 1.0.8)

facade_geometry3 = Brep([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])
# Facade
# Options
facade_geometry1 = Brep([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])
facade_geometry2 = Brep([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])

stream_filter = StreamFilter(Gate=Slider(2, range=0..2), Stream0=facade_geometry1, Stream1=facade_geometry2, Stream2=facade_geometry3)
# Other Inputs
toggle = BooleanToggle(True)

grid_size = Panel("0.25")
opaque_geometry = Brep(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)
test_surface = Brep(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)

facade_geometry = Brep(stream_filter)
edges = BrepEdges(Brep=opaque_geometry)  # -> Naked, Interior, NonManifold
viewpercent = LBViewPercent(
    view_type="Horizontal30DegreeOffset",
    resolution="5",
    geometry=flatten(test_surface),
    context=flatten([facade_geometry, opaque_geometry]),
    grid_size=grid_size,
    run=toggle)  # -> report, points, view_vecs, results, mesh, legend, title, int_mtx; plug-in component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
