# Grasshopper definition direct sun study.gh (Grasshopper 1.0.8)

# ----
# HOUR OF YEAR
number_slider = Slider(6, range=0..11)
hoy = LBCalculateHOY(month=number_slider, day=Slider(10, range=0..31), hour=Slider(12, range=0..23), minute=Slider(13, range=0..59))  # -> flatten(hoy), flatten(doy), flatten(date); plug-in component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

# ----
# EnergyPlus Weather file
file_path = FilePath("C:\Users\davea\Downloads\IND_MH_Pune.430630_TMYx.2004-2018.epw")
importepw = LBImportEPW(epw_file=file_path)  # -> location, dry_bulb_temperature, dew_point_temperature, relative_humidity, wind_speed, wind_direction, direct_normal_rad, diffuse_horizontal_rad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; plug-in component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

# ----
# Create Sunpath
number_slider_2 = Slider(1, range=0..100)
point = Point(<point referenced from the Rhino model>)
sunpath = LBSunPath(location=importepw.location, hoys=hoy.hoy, center_pt=point, scale=number_slider_2)  # -> report, vectors, altitudes, azimuths, hoys, sun_pts, analemma, daily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; plug-in component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

panel = Panel(hoy.date)

# ----
# Run Direct Sun Study
number_slider_3 = Slider(0.4076, range=0..1)
brep = Brep(<brep referenced from the Rhino model>)
brep_2 = Brep(<brep referenced from the Rhino model>)
directsunhours = LBDirectSunHours(
    vectors=flatten(sunpath.vectors),
    geometry=flatten(brep),
    context=flatten(brep_2),
    grid_size=number_slider_3,
    run=Toggle(True))  # -> report, points, results, mesh, legend, title, int_mtx; plug-in component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
