# Grasshopper definition outdoor comfort.gh (Grasshopper 1.0.8)

# ----
# Import EPW
file_path = FilePath("C:\Users\davea\Downloads\IND_MH_Pune.430630_TMYx.2004-2018.epw")
importepw = LBImportEPW(epw_file=file_path)  # -> location, dry_bulb_temperature, dew_point_temperature, relative_humidity, wind_speed, wind_direction, direct_normal_rad, diffuse_horizontal_rad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; plug-in component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

toggle = BooleanToggle(True)

# ----
# Compute MRT in the Sun
toggle_2 = BooleanToggle(True)
outdoorsolarmrt = LBOutdoorSolarMRT(
    location=importepw.location,
    surface_temp=importepw.dry_bulb_temperature,
    dir_norm_rad=importepw.direct_normal_rad,
    diff_horiz_rad=importepw.diffuse_horizontal_rad,
    horiz_infrared=importepw.horizontal_infrared_rad,
    run=toggle_2)  # -> report, short_erf, long_erf, short_dmrt, long_dmrt, mrt; plug-in component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

# ----
# Sun and Wind
utci = LBUTCIComfort(
    air_temp=importepw.dry_bulb_temperature,
    mrt=outdoorsolarmrt.mrt,
    rel_humid=importepw.relative_humidity,
    wind_vel=importepw.wind_speed,
    run=toggle)  # -> report, utci, comfort, condition, category, comf_obj; plug-in component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

# ----
# Sun and No Wind
utci_2 = LBUTCIComfort(air_temp=importepw.dry_bulb_temperature, mrt=outdoorsolarmrt.mrt, rel_humid=importepw.relative_humidity, run=toggle)  # -> report, utci, comfort, condition, category, comf_obj; plug-in component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

# ----
# Wind and No Sun
utci_3 = LBUTCIComfort(
    air_temp=importepw.dry_bulb_temperature,
    rel_humid=importepw.relative_humidity,
    wind_vel=importepw.wind_speed,
    run=toggle)  # -> report, utci, comfort, condition, category, comf_obj; plug-in component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

# ----
# No Wind and No Sun
utci_4 = LBUTCIComfort(air_temp=importepw.dry_bulb_temperature, rel_humid=importepw.relative_humidity, run=toggle)  # -> report, utci, comfort, condition, category, comf_obj; plug-in component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

# ----
# % of Time Comfortable
comfstat = LBComfortStatistics(comf_obj=[utci.comf_obj, utci_2.comf_obj, utci_3.comf_obj, utci_4.comf_obj])  # -> pct_hot, pct_neutral, pct_cold; plug-in component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
panel = Panel(comfstat.pct_neutral)

# ----
# Plot on an Hourly Chart
toggle_3 = BooleanToggle(False)
hourlyplot = LBHourlyPlot(data=[utci.category, utci_2.category, utci_3.category, utci_4.category], reverse_y=toggle_3, clock_24=Toggle(True))  # -> report, mesh, legend, borders, labels, title, vis_set; plug-in component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
geo = Geometry([hourlyplot.mesh, hourlyplot.legend, hourlyplot.borders, hourlyplot.labels])
