# Grasshopper definition radiation benefit on sunpath.gh (Grasshopper 1.0.8)

# ----
# Download and Import EPW
file_path = FilePath("C:\Users\davea\Downloads\IND_MH_Pune.430630_TMYx.2004-2018.epw")
importepw = LBImportEPW(epw_file=file_path)  # -> location, dry_bulb_temperature, dew_point_temperature, relative_humidity, wind_speed, wind_direction, direct_normal_rad, diffuse_horizontal_rad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; plug-in component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

building_balance_point = Slider(15, range=10..20)
benefitmatrix = LBBenefitSkyMatrix(
    location=importepw.location,
    temperature=importepw.dry_bulb_temperature,
    bal_temp=building_balance_point,
    direct_rad=importepw.direct_normal_rad,
    diffuse_rad=importepw.diffuse_horizontal_rad)  # -> report, sky_mtx; plug-in component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

pt = Point(Point(209.9418744, 195.2042226, 0))

sunpath = LBSunPath(location=importepw.location, center_pt=pt, scale=1, projection="Stereographic")  # -> report, vectors, altitudes, azimuths, hoys, sun_pts, analemma, daily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; plug-in component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
skydome = LBSkyDome(sky_mtx=benefitmatrix.sky_mtx, center_pt=pt, projection="Stereographic")  # -> report, mesh, compass, legend, title, patch_vecs, patch_values, mesh_values, vis_set; plug-in component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

# ----
# SunPath and Radiation Dome
# Shading Mask for Context
brep = Brep([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])
symask = LBSkyMask(context=brep, density="3", center=pt, projection="orthographic")  # -> report, context_mask, orient_mask, strategy_mask, sky_mask, context_view, orient_view, strategy_view, sky_view; plug-in component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

geo = Geometry([skydome.mesh, skydome.legend])
