# Grasshopper definition radiation graphics.gh (Grasshopper 1.0.8)

# ----
# Import Weather Data
panel = Panel("https://energyplus-weather.s3.amazonaws.com/asia_wmo_region_2/IND/IND_Pune.430630_ISHRAE/IND_Pune.430630_ISHRAE.zip")
downloadepw = LBDownloadWeather(weather_URL=panel)  # -> epw_file, stat_file, ddy_file; plug-in component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
importepw = LBImportEPW(epw_file=downloadepw.epw_file)  # -> location, dry_bulb_temperature, dew_point_temperature, relative_humidity, wind_speed, wind_direction, direct_normal_rad, diffuse_horizontal_rad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; plug-in component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
importstat = LBImportSTAT(stat_file=downloadepw.stat_file)  # -> location, ashrae_zone, koppen_zone, clear_dir_norm_rad, clear_diff_horiz_rad, ann_heat_dday_996, ann_heat_dday_990, ann_cool_dday_004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; plug-in component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

# ----
# Summer Design Day Radiation
panel_2 = Panel("21")
analysisperiod = LBAnalysisPeriod(start_month="7", start_day=panel_2, start_hour=0, end_month="7", end_day=panel_2)  # -> period, hoys, dates; plug-in component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
skymatrix = LBCumulativeSkyMatrix(
    location=importstat.location,
    direct_rad=importstat.clear_dir_norm_rad,
    diffuse_rad=importstat.clear_diff_horiz_rad,
    hoys=analysisperiod.hoys)  # -> report, sky_mtx; plug-in component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

# ----
# Annual Radiation Benefit/Harm
benefitmatrix = LBBenefitSkyMatrix(
    location=importepw.location,
    temperature=importepw.dry_bulb_temperature,
    direct_rad=importepw.direct_normal_rad,
    diffuse_rad=importepw.diffuse_horizontal_rad)  # -> report, sky_mtx; plug-in component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

# ----
# Annual Radiation
skymatrix_2 = LBCumulativeSkyMatrix(location=importepw.location, direct_rad=importepw.direct_normal_rad, diffuse_rad=importepw.diffuse_horizontal_rad)  # -> report, sky_mtx; plug-in component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

data = Data(skymatrix_2.sky_mtx)
data_2 = Data(skymatrix.sky_mtx)

# ----
# Visualize Radiation Dome
panel_3 = Panel("Equidistant")  # disabled
panel_4 = Panel("300, 0, 0")  # disabled
radiationdome = LBRadiationDome(sky_mtx=data_2, center_pt=panel_4, scale=1, projection=panel_3)  # -> report, mesh, compass, legend, title, dir_vecs, dir_values, max_pt, max_info, vis_set; disabled; plug-in component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

# ----
# Visualize Sky Matrix
panel_5 = Panel("Equidistant")  # disabled
panel_6 = Panel("-300, 0, 0")  # disabled
skydome = LBSkyDome(sky_mtx=data_2, center_pt=panel_6, projection=panel_5)  # -> report, mesh, compass, legend, title, patch_vecs, patch_values, mesh_values, vis_set; disabled; plug-in component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

# ----
# Visualize Radiation Rose
radrose = LBRadiationRose(sky_mtx=data_2, arrow_scale=1)  # -> report, mesh, compass, orient_lines, legend, title, dir_vecs, dir_values, vis_set; disabled; plug-in component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

data_3 = Data(benefitmatrix.sky_mtx)

# ----
# Visualize Radiation Dome
panel_7 = Panel("Equidistant")  # disabled
panel_8 = Panel("300, 0, 0")  # disabled
radiationdome_2 = LBRadiationDome(sky_mtx=data_3, center_pt=panel_8, scale=1, projection=panel_7)  # -> report, mesh, compass, legend, title, dir_vecs, dir_values, max_pt, max_info, vis_set; disabled; plug-in component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

# ----
# Visualize Radiation Dome
panel_9 = Panel("Equidistant")
radiationdome_3 = LBRadiationDome(sky_mtx=data, center_pt="300, 0, 0", scale=1, projection=panel_9)  # -> report, mesh, compass, legend, title, dir_vecs, dir_values, max_pt, max_info, vis_set; disabled; plug-in component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

# ----
# Visualize Sky Matrix
panel_10 = Panel("Equidistant")  # disabled
panel_11 = Panel("-300, 0, 0")  # disabled
skydome_2 = LBSkyDome(sky_mtx=data_3, center_pt=panel_11, projection=panel_10)  # -> report, mesh, compass, legend, title, patch_vecs, patch_values, mesh_values, vis_set; disabled; plug-in component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

# ----
# Visualize Sky Matrix
panel_12 = Panel("Equidistant")
skydome_3 = LBSkyDome(sky_mtx=data, center_pt="-300, 0, 0", projection=panel_12)  # -> report, mesh, compass, legend, title, patch_vecs, patch_values, mesh_values, vis_set; plug-in component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

# ----
# Visualize Radiation Rose
radrose_2 = LBRadiationRose(sky_mtx=data_3, arrow_scale=1)  # -> report, mesh, compass, orient_lines, legend, title, dir_vecs, dir_values, vis_set; disabled; plug-in component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

# ----
# Visualize Radiation Rose
radrose_3 = LBRadiationRose(sky_mtx=data, arrow_scale=1)  # -> report, mesh, compass, orient_lines, legend, title, dir_vecs, dir_values, vis_set; disabled; plug-in component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
