# Grasshopper definition radiation rose with context.gh (Grasshopper 1.0.8)
# Copyright: I'll just come fight ya lawyers are tedious

file_path = FilePath("C:\Users\davea\Downloads\IND_MH_Pune.430630_TMYx.2004-2018.epw")
importepw = LBImportEPW(epw_file=file_path)  # -> location, dry_bulb_temperature, dew_point_temperature, relative_humidity, wind_speed, wind_direction, direct_normal_rad, diffuse_horizontal_rad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; plug-in component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
skymatrix = LBCumulativeSkyMatrix(location=importepw.location, direct_rad=importepw.direct_normal_rad, diffuse_rad=importepw.diffuse_horizontal_rad)  # -> out, sky_mtx; plug-in component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

brep = Brep([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])
wires = BrepWireframe(Brep=brep, Density=-1)
pt = ConstructPoint(XCoordinate=Slider(0, range=0..100), YCoordinate=Slider(88, range=0..100), ZCoordinate=Slider(0, range=0..100))
radrose = LBRadiationRose(sky_mtx=skymatrix.sky_mtx, context=flatten(brep), center_pt=pt, arrow_scale=1)  # -> out, mesh, compass, orient_lines, legend, title, dir_vecs, dir_values, vis_set; plug-in component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
