# Grasshopper definition raytracing study.gh (Grasshopper 1.0.8)

# ----
# Import Location from EPW File
panel = Panel("https://climate.onebuilding.org/WMO_Region_2_Asia/IND_India/MH_Maharashtra/IND_MH_Pune.430630_TMYx.zip")
downloadepw = LBDownloadWeather(weather_URL=panel)  # -> epw_file, stat_file, ddy_file; plug-in component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
importloc = LBImportLocation(epw_file=downloadepw.epw_file)  # -> location; plug-in component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

hoy = LBCalculateHOY(month=Slider(12, range=1..12), hour=Slider(12, range=0..23))  # -> flatten(hoy), flatten(doy), flatten(date); plug-in component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

# ----
# Create Sunpath
panel_2 = Panel("20")
sunpath = LBSunPath(north=panel_2, location=importloc, hoys=hoy.hoy, scale="0.3")  # -> report, vectors, altitudes, azimuths, hoys, sun_pts, analemma, daily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; plug-in component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

study_area = Geometry(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)
building = Geometry(<brep referenced from the Rhino model>)

# ----
# Perform Ray Tracing
number_slider = Slider(1, range=1..3)
number_slider_2 = Slider(35, range=0..100)
parabolic_geo = Geometry(<surface referenced from the Rhino model>)
ground = Geometry(<surface referenced from the Rhino model>)
srfraytrace = LBSurfaceRayTracing(
    vector=sunpath.vectors,
    source_geo=flatten(parabolic_geo),
    context=flatten([ground, building]),
    grid_size="3",
    bounce_count=number_slider,
    first_length=number_slider_2,
    last_length=number_slider_2,
    context_block=Toggle(True),
    run=Toggle(False))  # -> report, rays, int_pts; plug-in component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
item = ListItem(List=srfraytrace.int_pts, Index="-1", Wrap=True)
preview = CustomPreview(Geometry=item, Material=ColourSwatch(SwatchColor=RGB(255, 0, 0)))

sph = Sphere(Base=sunpath.sun_pts, Radius=1)
preview_2 = CustomPreview(Geometry=sph, Material=ColourSwatch(SwatchColor=RGB(255, 212, 0)))
preview_3 = CustomPreview(Geometry=srfraytrace.rays, Material=ColourSwatch(SwatchColor=RGB(255, 212, 0)))
