# Grasshopper definition views for LEED.gh (Grasshopper 1.0.8)

# ----
# LEED VERSION
view_resolution = Panel("3")
grid_size_rhino_model_units = Panel("1")
opaque_building_elements = Geometry([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])
# INPUTS
view_analysis_surface = Geometry([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])

# ----
# Run a Radial View Study
panel = Panel("30")
legendpar = LBLegendParameters(max=panel, num_decimals="0")  # -> leg_par; plug-in component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
viewpercent = LBViewPercent(
    view_type="0",
    resolution=view_resolution,
    geometry=flatten(view_analysis_surface),
    context=flatten(opaque_building_elements),
    grid_size=grid_size_rhino_model_units,
    offset_dist="0.01",
    legend_par=legendpar,
    run=Toggle(True))  # -> report, points, view_vecs, results, mesh, legend, title, int_mtx; plug-in component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

brep_edges = BrepEdges(Brep=opaque_building_elements)  # -> Naked, Interior, NonManifold
exterior_windows = Geometry([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])
# Calculate Passing Criteria for LEED v4
xmatrix = LBDeconstructMatrix(matrix=flatten(viewpercent.int_mtx))  # -> values; plug-in component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
window_head_height_model_units = Panel("9.5")

# ----
# Calculate Passing Criteria for LEED v3
panel_2 = Panel("0")
equality = Equality(FirstNumber=flatten(viewpercent.results), SecondNumber=panel_2)  # -> Equality, Inequality

surface_closest_point = SurfaceClosestPoint(Point=flatten(viewpercent.points), Surface=graft(exterior_windows))  # -> Point, UVPoint, Distance
flip_matrix = FlipMatrix(Data=surface_closest_point.Distance)
ghpython_script = PythonScript(ptIsVisible=xmatrix)  # -> flatten(multipleLinesOfSight); inputs ptIsVisible: list of Int32
# ---------- ghpython_script: Python ----------
degCutoff = len(ptIsVisible)/4
multipleLinesOfSight = False
viewFound = -1

for i, view in enumerate(ptIsVisible):
    if view == 1:
        if viewFound == -1:
            viewFound = i
        else:
            if i - viewFound > degCutoff:
                multipleLinesOfSight = True
# ---------- end ghpython_script ----------
sort_list = SortList(Keys=flip_matrix)  # -> Keys, ValuesA
list_item = ListItem(List=sort_list.Keys, Index=0, Wrap=True)  # -> flatten(Item)
multiplication = Multiplication(A=window_head_height_model_units, B="3")
smaller_than = SmallerThan(FirstNumber=list_item, SecondNumber=multiplication)  # -> SmallerThan, OrEqualTo
gate_and = GateAnd(A=flatten(equality.Inequality), B=flatten(smaller_than.SmallerThan))
views_with_3x_head_height = Boolean(gate_and)
views_with_multiple_lines_of_sight = Boolean(ghpython_script)
gate_and_2 = GateAnd(A=views_with_3x_head_height, B=views_with_multiple_lines_of_sight)

value_list = ValueList({"LEED v3": 0, "LEED v4": 1}, selected="LEED v4")

# ----
# Display the Criteria for Right LEED Version
leed_v3_views_to_the_outdoors = Boolean(equality.Inequality)
leed_v4_views_to_the_outdoors = Boolean(gate_and_2)
stream_gate = StreamGate(Stream=leed_v3_views_to_the_outdoors, Gate=value_list)  # -> Target0, Target1
stream_gate_2 = StreamGate(Stream=leed_v4_views_to_the_outdoors, Gate=value_list)  # -> Target0, Target1
passing_failureresults = Data([stream_gate.Target0, stream_gate_2.Target1])

leed_version = Data(value_list)

legendpar_2 = LBLegendParameters(colors=[ColourSwatch(SwatchColor=RGB(255, 0, 0)), ColourSwatch(SwatchColor=RGB(76, 212, 78))])  # -> leg_par; plug-in component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
# Make a Visualization of
# Passing and Failing Areas
viewsresults = Integer(flatten(passing_failureresults))
heatmap = LBSpatialHeatmap(values=viewsresults, mesh=viewpercent.mesh, legend_par=legendpar_2)  # -> mesh, legend, title, colors, legend_par, vis_set; plug-in component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

view_mesh = Mesh(viewpercent.mesh)
# Determine Whether you Pass LEED
analysis_surfaces = Brep(view_analysis_surface)
viewsresults_2 = Boolean(passing_failureresults)
# Turn Preview
# on here to see
# the Areas that
# Pass and Fail
# LEED Criteria
leed_pass_fail_visual = Geometry(heatmap.mesh)

cull_faces = CullFaces(Mesh=view_mesh, Pattern=viewsresults_2)
panel_3 = Panel(""" v3
 v4""")
area = Area(Geometry=analysis_surfaces)  # -> flatten(Area), Centroid
area_2 = Area(Geometry=cull_faces)  # -> flatten(Area), Centroid
list_item_2 = ListItem(List=panel_3, Index=leed_version, Wrap=True)
mass_addition = MassAddition(Input=area_2.Area)  # -> Result, PartialResults
mass_addition_2 = MassAddition(Input=area.Area)  # -> Result, PartialResults
panel_4 = Panel("""90
75""")
list_item_3 = ListItem(List=panel_4, Index=leed_version, Wrap=True)
concatenate = Concatenate(FragmentA="You have passed LEED", FragmentB=list_item_2)
concatenate_2 = Concatenate(FragmentA="You have not passed LEED", FragmentB=list_item_2)

subtraction = Subtraction(A=mass_addition_2.Result, B=mass_addition.Result)

division = Division(A=subtraction, B=mass_addition_2.Result)
multiplication_2 = Multiplication(A=division, B="100")
larger_than = LargerThan(FirstNumber=multiplication_2, SecondNumber=list_item_3)  # -> LargerThan, OrEqualTo
dispatch = Dispatch(List=concatenate_2, DispatchPattern=larger_than.LargerThan)  # -> ListA, ListB
dispatch_2 = Dispatch(List=concatenate, DispatchPattern=larger_than.LargerThan)  # -> ListA, ListB
expression = Expression(x=multiplication_2, Expression="Round(x,1)")
concatenate_3 = Concatenate(FragmentA=expression, FragmentB="%")
data = Data([dispatch_2.ListA, dispatch.ListB])

leed_status = Panel(data)
percent_with_view_to_the_outdoors = Panel(concatenate_3)
